# Grasshopper definition canopy-model-sensitivityanalysis.gh (Grasshopper 1.0.8)
# plug-ins: RhinoCodePluginGH, Anemone, SurfaceTrails2

# ----
# boolean intersection surfaces
colmm = CollisionManyMany()  # -> Collision, Indices
_1 = Integer(1)
volume_collisions = Panel(colmm.Indices)
cull = CullPattern(List=colmm.Indices, CullPattern=colmm.Collision)
lng = ListLength(List=cull)
subtraction = Subtraction(A=lng, B=_1)
cull_2 = CullPattern(CullPattern=colmm.Collision)
counter = Integer(0)
loop_start = LoopStart(Repeat=subtraction, Data=counter)  # -> port, Counter, Data
item = ListItem(List=cull, Index=loop_start.Data, Wrap=True)
item_2 = ListItem(List=cull_2, Index=loop_start.Data, Wrap=True)
expression = Expression(i=loop_start.Data, Expression="If(i = 0, True, False)")
item_3 = ListItem(Index=item, Wrap=True)
_1_2 = Integer(1)
sint = SolidIntersection(BrepsA=item_3, BrepsB=item_2)
addition = Addition(A=loop_start.Data, B=_1_2)
loop_end = LoopEnd(port=loop_start.port, Exit=False, Data=addition, TimeOutVal=0, pausedState=False, state="Last & Record")
resettablerecorder = ResettableDataRecorder(Data=sint, Reset=expression, Clear=expression)
sunion = SolidUnion(Breps=resettablerecorder)
volume = Volume(Geometry=sunion)  # -> Volume, Centroid
intersection_volumes = Panel(volume.Volume)
ma = MassAddition(Input=intersection_volumes)  # -> Result, PartialResults
total_intersection_volume = Panel(ma.Result)

N = Integer(136)
counter_2 = Integer(0)
loop_start_2 = LoopStart(N=N, D0=counter_2)  # -> port, Counter, Data, Data_2, Data_3, Data_4

counter_3 = Integer(0)
N_2 = Integer(100)
loop_start_3 = LoopStart(N=N_2, T=loop_start_2.Counter, D0=counter_3)  # -> port, Counter, Data, Data_2, Data_3

rec = DataRecorder(loop_start_2.Counter, DataLimit=-10, RecordData=True)
panel = Panel(rec)

# ----
# Import file and read line data into Grasshopper
canopy_data = FilePath("C:\Users\jone3247\Desktop\forest-canopy-model\data\sensitivityAnalysis_data_forRhino.csv")
file = ReadFile(File=canopy_data, PerLineParse=True)
imported_data = Panel(file)
site = Integer(loop_start_2.Data)
item_4 = ListItem(List=imported_data, Index=loop_start_2.Data, Wrap=True)

expression_2 = Expression(c=loop_start_3.Data, Expression="If(c = 0, True, False)")

# ----
# Set up
# Random sample DBH [cm] and
# distance [m] values from the
# normal distribution
# Use Python to split data
# into individual variables
# of interest
# Compute tree data
split_data = Python3Script(x=item_4)  # -> out, pCon, distMu, distSigma, dbhMu, dbhSigma, n
# ---------- split_data: Python ----------
#split line into variable chunks
chunks = x.split(',')
print(chunks)

#allocate variables
pCon = chunks[6]
distMu = chunks[1]
distSigma = chunks[2]
dbhMu = chunks[3]
dbhSigma = chunks[4]
n = chunks[5]
# ---------- end split_data ----------
generate_data = Python3Script(
    n=split_data.n,
    seed=loop_start_3.Data,
    distMu=split_data.distMu,
    distSigma=split_data.distSigma,
    dbhMu=split_data.dbhMu,
    dbhSigma=split_data.dbhSigma)  # -> out, dists, dbhs; inputs n: Int32, seed: Int32, distMu: Double, distSigma: Double, dbhMu: Double, dbhSigma: Double
# ---------- generate_data: Python ----------
# requirements: numpy
import numpy as np

#Generate distances
dists = np.random.normal(loc = distMu, scale = distSigma, size = n)
#Check all are in correct range
while ((dists > 8).any()) | ((dists < 0).any()):
    dists = np.random.normal(loc = distMu, scale = distSigma, size = n)

#Generate DBHs (in cm)
dbhs = np.random.normal(loc = dbhMu, scale = dbhSigma, size = n)
#Check all are in correct range
while(dbhs < 0).any():
    dbhs = np.random.normal(loc = dbhMu, scale = dbhSigma, size = n)

#covert dtypes
dbhs = dbhs.tolist()
dists = dists.tolist()
# ---------- end generate_data ----------
generate_tree_data = Python3Script(dbhs=generate_data.dbhs, dists=generate_data.dists, n=split_data.n, pCon=split_data.pCon)  # -> out, BA, nCon, nDec; inputs dbhs: list of Double, dists: list of Double
# ---------- generate_tree_data: Python ----------
# requirements: numpy
import numpy as np
import math


#Calculate Basal Area for site (m2/hectare)
BA = []
for dbh in dbhs:
    t = math.pi*((dbh/2)**2)*(1/(math.pi*((26.2)**2)))*(1/0.00000929)*(0.001)
    BA.append(t)


BA = sum(BA) #in m2/hectare

#Based on pCon, assign conifs
nCon = int(int(n)*float(pCon))
nDec = int(n) - nCon
# ---------- end generate_tree_data ----------

# ----
# Create random unit vectors
# to shift trees in space
_2pi = Number(6.28)
_0 = Integer(0)
dom = ConstructDomain(DomainStart=_0, DomainEnd=_2pi)
X = UnitX(Factor=generate_data.dists)
random = Random(Range=dom, Number=split_data.n, Seed=loop_start_3.Data)
xy = XYPlane(Origin=Point(0, 0, 0))
vrot = Rotate(Vector=X, Axis=xy, Angle=random)
split = SplitList(List=generate_data.dists, Index=generate_tree_data.nCon)  # -> ListA, ListB
split_2 = SplitList(List=vrot, Index=generate_tree_data.nCon)  # -> ListA, ListB
panel_2 = Panel(vrot)
amp = Amplitude(Vector=split_2.ListA, Amplitude=split.ListA)
conif_vector_translations = Panel(amp)

# ----
# Loop through the coniferous trees
# move tree
# draw tree
k = Integer(0)
loop_start_4 = LoopStart(n=generate_tree_data.nCon, D0=k, D1=loop_start_3.Counter)  # -> port, Counter, Data, Data_2
expression_3 = Expression(i=loop_start_4.Data, Expression="If(i = 0, True, False)")
make_conif_tree = Python3Script(n=split_data.n, k=loop_start_4.Counter, nCon=generate_tree_data.nCon, BA=generate_tree_data.BA, dbhs=generate_data.dbhs)  # -> out, height, crown; inputs n: Int32, k: Int32, nCon: Int32, BA: Double, dbhs: list
# ---------- make_conif_tree: Python ----------
import math
#check
if(n > 0):
    dbhs_set = dbhs[0:nCon+1]
    dbh = dbhs_set[k-1]*0.39370079 #convert to in
    
    #Simulate coniferous trees as Black Spruce
    #Calculate height
    height_ft = 4.5 + 2136.9468*math.exp(-6.2688*math.pow(dbh, -0.2161)) #feet
    height = height_ft*0.3048 #transform to m
    #Calulate crown ratio
    cr = 10*(5.540/(1 + 0.0072*BA)) + (4.200*(1 - math.exp(-0.0530*dbh)))
    #Calculate crown
    crown_ft = -0.8566 + 0.9693*dbh + 0.0573*cr   
    crown = (crown_ft*0.3048)/2
# ---------- end make_conif_tree ----------
resettablerecorder_2 = ResettableDataRecorder(Data=loop_start_4.Counter, Reset=expression_3, Clear=expression_3)
conif_loop_counter = Panel(resettablerecorder_2)
conif = Cone(Base=PlaneXY(0, 0, 0), Radius=make_conif_tree.crown, Length=make_conif_tree.height)  # -> Cone, Tip
item_5 = ListItem(List=conif_vector_translations, Index=loop_start_4.Data, Wrap=True)
move = Move(Geometry=conif.Cone, Motion=item_5)  # -> Geometry, Transform
resettablerecorder_3 = ResettableDataRecorder(Data=move.Geometry, Reset=expression_3, Clear=expression_3)
_1_3 = Integer(1)
addition_2 = Addition(A=loop_start_4.Data, B=_1_3)
loop_end_2 = LoopEnd(
    port=loop_start_4.port,
    Exit=False,
    Data=addition_2,
    Data_2=loop_start_4.Data_2,
    TimeOutVal=0,
    pausedState=False,
    state="Last & Record")  # -> D0, D1

# ----
# Loop through the deciduous trees
m = Integer(0)
loop_start_5 = LoopStart(n=generate_tree_data.nDec, D0=m, D1=loop_start_3.Counter)  # -> port, Counter, Data, Data_2
make_decid_tree = Python3Script(
    n=generate_tree_data.nDec,
    m=loop_start_5.Counter,
    nCon=generate_tree_data.nCon,
    BA=generate_tree_data.BA,
    dbhs=generate_data.dbhs)  # -> out, height, crown; inputs m: Int32, dbhs: list
# ---------- make_decid_tree: Python ----------
import math

#check
if(n > 0):
    dbhs = dbhs[nCon:]
    dbh = dbhs[m-1]*0.39370079 #convert to in
    print(dbh)

    #Simulate deciduous trees as Red Maple
    #Calculate height
    height_ft = 4.5 + math.exp(4.3379 + ((-3.8214)/(dbh + 1))) #feet
    height = height_ft*0.3048 #transform to m
    #Calulate crown ratio
    #cr = 10*(4.340/(1 + 0.0046*ba)) + (1.820*(1 - math.exp(-0.2740*dbh)))
    #Calculate crown
    #crown_ft = 2.7562 + 1.4212*dbh - 0.0143*math.pow(dbh, 2) + 0.0993*cr - 0.0276*hi 
    #crown = crown_ft*0.3048
    #Simply use BA as crown width
    crown = (dbh*0.0254)/2 #in to m then to radius
# ---------- end make_decid_tree ----------
expression_4 = Expression(i=loop_start_5.Data, Expression="If(i = 0, True, False)")
resettablerecorder_4 = ResettableDataRecorder(Data=loop_start_5.Data, Reset=expression_4, Clear=expression_4)
dec_loop_counter = Panel(resettablerecorder_4)
amp_2 = Amplitude(Vector=split_2.ListB, Amplitude=split.ListB)
decid = Cylinder(Base=PlaneXY(0, 0, 0), Radius=make_decid_tree.crown, Length=make_decid_tree.height)
dec_vector_translations = Panel(amp_2)
item_6 = ListItem(List=dec_vector_translations, Index=loop_start_5.Data, Wrap=True)
move_2 = Move(Geometry=decid, Motion=item_6)  # -> Geometry, Transform
resettablerecorder_5 = ResettableDataRecorder(Data=move_2.Geometry, Reset=expression_4, Clear=expression_4)
_1_4 = Integer(1)
addition_3 = Addition(A=loop_start_5.Data, B=_1_4)
loop_end_3 = LoopEnd(
    port=loop_start_5.port,
    Exit=False,
    Data=addition_3,
    Data_2=loop_start_5.Data_2,
    TimeOutVal=0,
    pausedState=False,
    state="Last & Record")  # -> D0, D1

merge = Merge(Data1=resettablerecorder_3, Data2=resettablerecorder_5)
clean = CleanTree(RemoveNulls=True, RemoveInvalid=True, RemoveEmpty=False, Tree=merge)
brep = Brep(clean)

# ----
# boolean union surfaces
sunion_2 = SolidUnion(Breps=brep)
volume_2 = Volume(Geometry=sunion_2, UseTasks=False)  # -> Volume, Centroid
ma_2 = MassAddition(Input=volume_2.Volume)  # -> Result, PartialResults
na = Integer(-1)
resettablerecorder_6 = ResettableDataRecorder(Data=ma_2.Result, Reset=expression_2, Clear=expression_2)
nullrep = ReplaceNulls(Items=resettablerecorder_6, Replacements=na)  # -> Items, Count
cumulative_union_volume = Panel(nullrep.Items)
graph = QuickGraph(nullrep.Items, SortOrder=0)

volume_3 = Volume(Geometry=brep, UseTasks=False)  # -> Volume, Centroid
ma_3 = MassAddition(Input=volume_3.Volume)  # -> Result, PartialResults
resettablerecorder_7 = ResettableDataRecorder(Data=ma_3.Result, Reset=expression_2, Clear=expression_2)
nullrep_2 = ReplaceNulls(Items=resettablerecorder_7, Replacements=na)  # -> Items, Count
cumulative_total_volume = Panel(nullrep_2.Items)

panel_3 = Panel("C:/Users/jone3247/Desktop/forest-canopy-model/data/sensitivityanalysisoutput/")
save_data = Python3Script(SavePath=panel_3, SITE=site, DistMu=split_data.distMu, DistSigma=split_data.distSigma, dat=nullrep.Items)  # -> out, a; inputs dat: list
# ---------- save_data: Python ----------
# requirements: numpy
import numpy as np

print(dat)
path = SavePath + 'canopyUnion-site-' + str(SITE) + 'Mu' + str(DistMu) + 'SD' + str(DistSigma) + '.txt'
np.savetxt(path, dat, fmt = '%5.5f')
# ---------- end save_data ----------

graph_2 = QuickGraph(nullrep_2.Items, SortOrder=0)
save_data_2 = Python3Script(SavePath=panel_3, SITE=site, DistMu=split_data.distMu, DistSigma=split_data.distSigma, dat=nullrep_2.Items)  # -> out, a; inputs dat: list
# ---------- save_data_2: Python ----------
# requirements: numpy
import numpy as np

print(dat)
path = SavePath + 'canopyTotal-site-' + str(SITE) + 'Mu' + str(DistMu) + 'SD' + str(DistSigma) + '.txt'
np.savetxt(path, dat, fmt = '%5.5f')
# ---------- end save_data_2 ----------
_1_5 = Integer(1)

_1_6 = Integer(1)
addition_4 = Addition(A=loop_start_3.Data, B=_1_6)
running = Running(
    port=loop_start_3.port,
    Exit=False,
    Data=addition_4,
    Data_2=loop_end_2.D0,
    Data_3=loop_end_3.D1,
    TimeOutVal=0,
    pausedState=False,
    state="Last & Record")  # -> D0, D1, D2

addition_5 = Addition(A=loop_start_2.Data, B=_1_5)
running_2 = Running(
    port=loop_start_2.port,
    Exit=False,
    Data=addition_5,
    Data_2=running.D0,
    Data_3=running.D1,
    Data_4=running.D2,
    TimeOutVal=0,
    pausedState=False,
    state="Constant & Record")  # -> D0, D1, D2, D3
